vi "Interpolate.gviweb"   [LabVIEW NXG 5.0.0]
inputs:
  "y input": f64
  "previoius y": f64[]
  "x input": f64
outputs:
  "y output": f64
  "new y": f64[]
  "x output": f64
diagram:
  Array Index(array=$"previoius y") -> (out0[2]=w1)
  Is Equal(x=w1, y=$"y input") -> w2
  case (w2) {
    frame False, Default {
      Interpolate 1D Array(array of numbers or points=$"previoius y", fractional index or x=$"x input") -> w5
      Build Array(w1, $"y input") -> w6
      Interpolate 1D Array(array of numbers or points=w6, fractional index or x=0.5) -> w7
      Build Array(w5, w7, $"y input") -> w3
      w4 = 0.1
    }
    frame True {
      w3 = $"previoius y"
      w4 = $"x input"
    }
  }
  $"new y" <- w3
  Interpolate 1D Array(array of numbers or points=w3, fractional index or x=w4) -> w8
  $"y output" <- w8
  Add(w4, 0.1) -> w9
  $"x output" <- w9
