vi "index.gviweb"   [LabVIEW NXG 5.0.0]
panel controls:
  "Power Button": bool
  "Accelerator": bool
  "Break": bool
  "Fill Tank": bool
  "Gear": f64
panel indicators:
  "Speedometer": f64
  "Tachometer": f64
  "Fuel": f64
  "Temperature": f64
  "Odometer": f64
uses:
  NI::Skyline::Configuration::Open Configuration.gvi
  NI::Skyline::TagHTTP::Open Tag.gvi
  NI::Skyline::TagHTTP::Write Tag (DBL).gvi
  NI::Skyline::TagHTTP::Read Tag (DBL).gvi
  Automotive WebVI::Interpolate.gviweb
  NI::Skyline::TagHTTP::Close Tag (Multiple).gvi
  NI::Skyline::Configuration::Close Configuration.gvi
diagram:
  call "Open Configuration.gvi"(server url="http://192.168.0.3:9090", username="admin", password="systemlink") -> (configuration=w1, error out=w2)
  w3 = ["Import.AutomotiveWebModule.Power Button DBL", "Import.AutomotiveWebModule.Accelerator DBL", "Import.AutomotiveWebModule.Break DBL", "Import.AutomotiveWebModule.Gear DBL", "Import.AutomotiveWebModule.Fill Tank DBL", "Export.Speedometer", "Export.Tachometer", "Export.Fuel Gauge", "Export.Engine Temperature", "Export.Odometer"]
  w4 = "Latitude_E6540--SN-GYJHD12--MAC-C4-D9-87-B5-5D-FB.FlexLogger."
  s1 = w2  # shift register
  for {
    w5 = each element of w3
    Concatenate Strings(w4, w5) -> w8
    call "Open Tag.gvi"(path=w8, data type="Double", error in=s1, configuration=w1) -> (tag=w9, error out=w10)
    w11 = cluster{"Element 1": f64[], "Element 2": f64} {all zero or empty}
    append w9 to w6
    append w11 to w7
    next s1 = w10
  }
  s2 = s1  # shift register
  s3 = w7  # shift register
  while {
    Wait Until Next Multiple(multiple to wait=100)
    s4 = s2  # shift register
    for {
      w12 = each element of w6
      w13 = each element of w3
      w14 = each element of s3
      case (w13) {
        frame Default {
          w17 = w12
          w18 = s4
          w19 = w14
        }
        frame "Import.AutomotiveWebModule.Power Button DBL" {
          Property Node(instance in=reference to "Fill Tank", "Disabled"=$"Power Button")
          Boolean To 0 Or 1(Boolean=$"Power Button") -> (0, 1=w20)
          To Double Precision Float(number=w20) -> w21
          call "Write Tag (DBL).gvi"(tag in=w12, value=w21, error in=s4) -> (tag out=w17, error out=w18)
          w19 = default
        }
        frame "Import.AutomotiveWebModule.Accelerator DBL" {
          Boolean To 0 Or 1(Boolean=$Accelerator) -> (0, 1=w22)
          To Double Precision Float(number=w22) -> w23
          call "Write Tag (DBL).gvi"(tag in=w12, value=w23, error in=s4) -> (tag out=w17, error out=w18)
          w19 = default
        }
        frame "Import.AutomotiveWebModule.Break DBL" {
          Boolean To 0 Or 1(Boolean=$Break) -> (0, 1=w24)
          To Double Precision Float(number=w24) -> w25
          call "Write Tag (DBL).gvi"(tag in=w12, value=w25, error in=s4) -> (tag out=w17, error out=w18)
          w19 = default
        }
        frame "Import.AutomotiveWebModule.Gear DBL" {
          call "Write Tag (DBL).gvi"(tag in=w12, value=$Gear, error in=s4) -> (tag out=w17, error out=w18)
          w19 = default
        }
        frame "Import.AutomotiveWebModule.Fill Tank DBL" {
          Boolean To 0 Or 1(Boolean=$"Fill Tank") -> (0, 1=w26)
          To Double Precision Float(number=w26) -> w27
          call "Write Tag (DBL).gvi"(tag in=w12, value=w27, error in=s4) -> (tag out=w17, error out=w18)
          w19 = default
        }
        frame "Export.Speedometer" {
          Property Node(instance in=w14) -> ("Element 1"=w28, "Element 2"=w29)
          call "Read Tag (DBL).gvi"(tag in=w12, error in=s4) -> (tag out=w17, value=w30, error out=w18)
          call "Interpolate.gviweb"(y input=w30, previoius y=w28, x input=w29) -> (y output=w31, new y=w32, x output=w33)
          Is Greater Than 0(x=w31) -> w34
          Property Node(instance in=reference to "Power Button", "Disabled"=w34)
          $Speedometer <- w31
          Build Cluster(w32, w33) -> w19
        }
        frame "Export.Tachometer" {
          Property Node(instance in=w14) -> ("Element 1"=w35, "Element 2"=w36)
          call "Read Tag (DBL).gvi"(tag in=w12, error in=s4) -> (tag out=w17, value=w37, error out=w18)
          call "Interpolate.gviweb"(y input=w37, previoius y=w35, x input=w36) -> (y output=w38, new y=w39, x output=w40)
          $Tachometer <- w38
          Build Cluster(w39, w40) -> w19
        }
        frame "Export.Fuel Gauge" {
          Property Node(instance in=w14) -> ("Element 1"=w41, "Element 2"=w42)
          call "Read Tag (DBL).gvi"(tag in=w12, error in=s4) -> (tag out=w17, value=w43, error out=w18)
          Subtract(x=20, y=w43) -> w44
          call "Interpolate.gviweb"(y input=w44, previoius y=w41, x input=w42) -> (y output=w45, new y=w46, x output=w47)
          $Fuel <- w45
          Build Cluster(w46, w47) -> w19
        }
        frame "Export.Engine Temperature" {
          Property Node(instance in=w14) -> ("Element 1"=w48, "Element 2"=w49)
          call "Read Tag (DBL).gvi"(tag in=w12, error in=s4) -> (tag out=w17, value=w50, error out=w18)
          call "Interpolate.gviweb"(y input=w50, previoius y=w48, x input=w49) -> (y output=w51, new y=w52, x output=w53)
          $Temperature <- w51
          Build Cluster(w52, w53) -> w19
        }
        frame "Export.Odometer" {
          call "Read Tag (DBL).gvi"(tag in=w12, error in=s4) -> (tag out=w17, value=w54, error out=w18)
          $Odometer <- w54
          w19 = default
        }
      }
      append w17 to w15
      append w19 to w16
      next s4 = w18
    }
    Logical Or(s4, FALSE) -> w55
    next s2 = s4
    next s3 = w16
    stop if w55
  }
  call "Close Tag (Multiple).gvi"(tags=w15, error in=s2) -> (error out=w56)
  call "Close Configuration.gvi"(configuration=w1, error in=w56)
